# Dynamo graph Google Charts - Pie Chart.dyn (Dynamo 1.3.1.1736)

categories = Categories("DuctCurves")
code_block = CodeBlock(x=categories) { x + ".html"; }
data_set_quantities_of_family = Custom[Data Set - Quantities of Family Types](category=categories)  # Creates a list of family types for a category with wublists containing the family type name and quantity.
watch = Watch(data_set_quantities_of_family)
generate_web_page_google_pie = Custom[Generate Web Page - Google Pie Chart](items=watch)  # Generates the HTML code for a web page that displays a responsive Google Pie Chart.
writeText = File.WriteText(code_block, generate_web_page_google_pie)
